# Grasshopper definition runner.ghx (Grasshopper 1.0.7)

# ---- group: Module Watcher
modulereloader = GhPythonScript(watch=Toggle(True), reload=Button())  # -> out; inputs watch: Boolean, reload: Boolean
# ---------- modulereloader: Python ----------
from develop import watch_modules, reload_modules


watch_modules(watch)
reload_modules(reload)
# ---------- end modulereloader ----------
panel = Panel(modulereloader)

# ----
examplecode = GhPythonScript()  # -> out, a
# ---------- examplecode: Python ----------
from logic import say_hi, draw_pentagon


say_hi()
a = draw_pentagon()
# ---------- end examplecode ----------
panel_2 = Panel(examplecode.out)
geo = Geometry(examplecode.a)
